# Grasshopper definition tessellation.gh (Grasshopper 0.9.76)
# plug-ins: Python Interpreter

mesh = Mesh(<mesh referenced from the Rhino model>)
dualmesh = PythonScript(M=mesh)  # -> out, dM; inputs M: Mesh
# ---------- dualmesh: Python ----------
import compas_rhino

from compas.datastructures import Mesh
from compas_rhino.helpers import mesh_from_guid
from compas_rhino.artists.meshartist import MeshArtist
from compas.topology import mesh_dual

from compas_rhino.geometry import RhinoMesh
from compas_ghpython.artists import MeshArtist


def my_mesh_dual(mesh, cls=None):
    """Construct the dual of a mesh."""
    if not cls:
        cls = type(mesh)

    dual = cls()

    fkey_centroid = {fkey: mesh.face_centroid(fkey) for fkey in mesh.faces()}
    outer = mesh.vertices_on_boundary()
    inner = list(set(mesh.vertices()) - set(outer))
    # print(set(mesh.vertices()))
    # print('vertice', set(mesh.vertices()))
    # print('outer', outer)
    # print('inner', inner)
    vertices = {}
    faces = {}

    # inner faces
    for key in inner:
        fkeys = mesh.vertex_faces(key, ordered=True)
        for fkey in fkeys:
            if fkey not in vertices:
                vertices[fkey] = fkey_centroid[fkey]
        faces[key] = fkeys

    # boundary condition
    for key in outer:
        fkeys = mesh.vertex_faces(key, ordered=True)
        if len(fkeys) > 1:
            for fkey in fkeys:
                if fkey not in vertices:
                    vertices[fkey] = fkey_centroid[fkey]

            vkeys = reversed(mesh.vertex_neighbors(key, ordered=True))
            for i, v in enumerate(vkeys):
                if mesh.is_edge_on_boundary(key, v) and (
                        len(fkey_centroid) * (i + 1) + fkey) not in vertices:
                    vertices[len(fkey_centroid) * (i + 1) +
                             fkey] = mesh.edge_midpoint(key, v)
                    fkeys.append(len(fkey_centroid) * (i + 1) + fkey)

            faces[key] = fkeys

    for key, (x, y, z) in vertices.items():
        dual.add_vertex(key, x=x, y=y, z=z)

    for fkey, vertices in faces.items():
        dual.add_face(vertices, fkey=fkey)

    return dual


if __name__ == '__main__':

    
    mesh = mesh_from_guid(Mesh, M)

    # make my own dula mesh with edge condition
    dual_mesh = my_mesh_dual(mesh)
    
    artist = MeshArtist(dual_mesh)
    dM = artist.draw_edges()
# ---------- end dualmesh ----------
voussoirinterface = PythonScript(crvs=dualmesh.dM)  # -> out, interface_m; inputs crvs: list of Curve
# ---------- voussoirinterface: Python ----------
import rhinoscriptsyntax as rs

from compas.datastructures import Mesh

from compas.geometry import scale_vector
from compas.geometry import add_vectors

from compas.geometry import planarize_faces
from compas.geometry import flatness
from compas.utilities import i_to_rgb

from compas_rhino.utilities import get_line_coordinates


def draw_interface(vertices, faces, maxdev):
    # don't refresh viewport
    # rs.EnableRedraw(False)
    # compute level of flatness
    flat_vals = flatness(vertices, faces, maxdev)

    srfs = []
    for i, face in enumerate(faces):
        # vertex coordinates for face
        pts = [vertices[key] for key in face]
        # create Rhino surface
        srfs.append(rs.AddSrfPt(pts))
        # color surface based on flatness
        rgb = i_to_rgb(flat_vals[i])
        # rs.ObjectColor(srfs[-1], rgb)
    
    return srfs
    # rs.AddObjectsToGroup(srfs, rs.AddGroup())
    # refresh viewport
    # rs.EnableRedraw(True)


def callback(k, callback_args=None):
    if k % 5 == 0:
        rs.Prompt('Iteration: {0} '.format(k))

if __name__ == '__main__':

    thickness = 0.2

    edge_crvs = crvs
    lines = get_line_coordinates(edge_crvs)

    mesh = Mesh.from_lines(lines, delete_boundary_face=True)
    
    
    # compute offset points top (a)
    vertices_list = []
    key_index_a = {}
    for i, key in enumerate(mesh.vertices()):
        pt = mesh.vertex_coordinates(key)
        normal = mesh.vertex_normal(key)
        vertices_list.append(
            add_vectors(pt, scale_vector(normal, thickness * .5)))
        # create key_index map top (a)
        key_index_a[key] = i

    # compute offset points bottom (b)
    n = mesh.number_of_vertices()
    key_index_b = {}
    for i, key in enumerate(mesh.vertices()):
        pt = mesh.vertex_coordinates(key)
        normal = mesh.vertex_normal(key)
        vertices_list.append(
            add_vectors(pt, scale_vector(normal, thickness * -.5)))
        # create key_index map bottom (b)
        key_index_b[key] = i + n

    # create faces for interfaces (voussoirs/blocks)
    faces_list = []
    for u, v in mesh.edges():
        faces_list.append(
            [key_index_a[u], key_index_a[v], key_index_b[v], key_index_b[u]])

    # draw and group interfaces
    maxdev = 0.015
    
    
    # interface_m = []
    
    interface_m = draw_interface(vertices_list, faces_list, maxdev)
# ---------- end voussoirinterface ----------
voussoirplanarize = PythonScript(crvs=dualmesh.dM)  # -> out, interface_m; inputs crvs: list of Curve; disabled
# ---------- voussoirplanarize: Python ----------
import rhinoscriptsyntax as rs

from compas.datastructures import Mesh

from compas.geometry import scale_vector
from compas.geometry import add_vectors

from compas.geometry import planarize_faces
from compas.geometry import flatness
from compas.utilities import i_to_rgb

from compas_rhino.utilities import get_line_coordinates


def draw_interface(vertices, faces, maxdev):
    # don't refresh viewport
    # rs.EnableRedraw(False)
    # compute level of flatness
    flat_vals = flatness(vertices, faces, maxdev)

    srfs = []
    for i, face in enumerate(faces):
        # vertex coordinates for face
        pts = [vertices[key] for key in face]
        # create Rhino surface
        srfs.append(rs.AddSrfPt(pts))
        # color surface based on flatness
        rgb = i_to_rgb(flat_vals[i])
        # rs.ObjectColor(srfs[-1], rgb)
    
    return srfs
    # rs.AddObjectsToGroup(srfs, rs.AddGroup())
    # refresh viewport
    # rs.EnableRedraw(True)


def callback(k, callback_args=None):
    if k % 5 == 0:
        rs.Prompt('Iteration: {0} '.format(k))

if __name__ == '__main__':

    thickness = 0.2

    edge_crvs = crvs
    lines = get_line_coordinates(edge_crvs)

    mesh = Mesh.from_lines(lines, delete_boundary_face=True)
    
    # compute offset points top (a)
    vertices_list = []
    key_index_a = {}
    for i, key in enumerate(mesh.vertices()):
        pt = mesh.vertex_coordinates(key)
        normal = mesh.vertex_normal(key)
        vertices_list.append(
            add_vectors(pt, scale_vector(normal, thickness * .5)))
        # create key_index map top (a)
        key_index_a[key] = i

    # compute offset points bottom (b)
    n = mesh.number_of_vertices()
    key_index_b = {}
    for i, key in enumerate(mesh.vertices()):
        pt = mesh.vertex_coordinates(key)
        normal = mesh.vertex_normal(key)
        vertices_list.append(
            add_vectors(pt, scale_vector(normal, thickness * -.5)))
        # create key_index map bottom (b)
        key_index_b[key] = i + n

    # create faces for interfaces (voussoirs/blocks)
    faces_list = []
    for u, v in mesh.edges():
        faces_list.append(
            [key_index_a[u], key_index_a[v], key_index_b[v], key_index_b[u]])

    # draw and group interfaces
    maxdev = 0.015
    
    
    # interface_m = []
    
    planarize_faces(vertices_list, faces_list, kmax=150, callback=callback)
    interface_m = draw_interface(vertices_list, faces_list, maxdev)
# ---------- end voussoirplanarize ----------
voussoirs = PythonScript(crvs=dualmesh.dM)  # -> out, voussoirs; inputs crvs: list of Curve
# ---------- voussoirs: Python ----------
import rhinoscriptsyntax as rs

from compas.datastructures import Mesh
from compas.geometry import scale_vector
from compas.geometry import add_vectors
from compas.geometry import planarize_faces
from compas.geometry import bounding_box
from compas_rhino.utilities import get_line_coordinates
from compas_rhino.artists.meshartist import MeshArtist

from compas_pattern.cad.rhino.utilities import draw_mesh
from compas_ghpython.artists import MeshArtist



def callback(k, callback_args=None):
    if k % 5 == 0:
        rs.Prompt('Iteration: {0} '.format(k))


if __name__ == '__main__':

    meshes = []
    # define min/max shell thickness
    thickness_max = 0.4
    thickness_min = 0.1
    new_z_delta = thickness_max - thickness_min

    # select tessellation
    edge_crvs = crvs
    lines = get_line_coordinates(edge_crvs)

    mesh = Mesh.from_lines(lines, delete_boundary_face=True)

    # find z-max and z-min of the tessellation geomerty
    bb = bounding_box(mesh.get_vertices_attributes(('x', 'y', 'z')))
    print(bb)
    z_max = bb[0][2]
    z_min = bb[4][2]
    z_delta = z_max - z_min

    vertices_list = []
    # compute offset points top (a)
    key_index_a = {}
    for i, key in enumerate(mesh.vertices()):
        pt = mesh.vertex_coordinates(key)
        normal = mesh.vertex_normal(key)
        thickness = (((pt[2] - z_min) * new_z_delta) / z_delta) + thickness_min
        vertices_list.append(
            add_vectors(pt, scale_vector(normal, thickness * .5)))
        # create key_index map top (a)
        key_index_a[key] = i

    # compute offset points bottom (b)
    n = mesh.number_of_vertices()
    key_index_b = {}
    for i, key in enumerate(mesh.vertices()):
        pt = mesh.vertex_coordinates(key)
        normal = mesh.vertex_normal(key)
        thickness = (((pt[2] - z_min) * new_z_delta) / z_delta) + thickness_min
        vertices_list.append(
            add_vectors(pt, scale_vector(normal, thickness * -.5)))
        # create key_index map bottom (b)
        key_index_b[key] = i + n

    # create faces for interfaces (voussoirs/blocks)
    faces_list = []
    for u, v in mesh.edges():
        faces_list.append(
            [key_index_a[u], key_index_a[v], key_index_b[v], key_index_b[u]])

    # planarize interfaces
    if 0:
        planarize_faces(vertices_list, faces_list, kmax=150, callback=callback)
        layer = 'voussoirs_planar'
    else:
        layer = 'voussoirs_ruled'

    # create mesh per voussoir/block
    voussoirs_meshes = {}
    for fkey in mesh.faces():

        # initiate mesh object
        voussoir_mesh = Mesh()
        # loop over edges of face (fkey)
        for u, v in mesh.face_halfedges(fkey):
            # add top vertices of face
            x, y, z = vertices_list[key_index_a[u]]
            voussoir_mesh.add_vertex(key_index_a[u], x=x, y=y, z=z)

            # add bottom vertices of face
            x, y, z = vertices_list[key_index_b[u]]
            voussoir_mesh.add_vertex(key_index_b[u], x=x, y=y, z=z)

            # add interfaces
            face = [
                key_index_a[v], key_index_a[u], key_index_b[u], key_index_b[v]
            ]
            voussoir_mesh.add_face(face)

        # add top and bottom faces
        face_a = [key_index_a[key] for key in mesh.face_vertices(fkey)]
        face_b = [key_index_b[key] for key in mesh.face_vertices(fkey)]
        face_b.reverse()
        voussoir_mesh.add_face(face_a)
        voussoir_mesh.add_face(face_b)

        voussoirs_meshes[fkey] = voussoir_mesh

    # draw all voussoir meshes
    for fkey, voussoir_mesh in voussoirs_meshes.items():
        
        artist = MeshArtist(voussoir_mesh)
        
        meshes.append(artist.draw_faces(join_faces=True))
#        meshes.append(artist.draw()) 
        
        
    voussoirs = meshes
# ---------- end voussoirs ----------
